# Grasshopper definition GrasshopperScriptTest.gh (Grasshopper 1.0.7)
# plug-ins: MeshEdit Components, Kangaroo Components, LunchBox, Weaverbird, Kangaroo2 Components, TetgenGH

brep = Brep(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)
mesh = MeshBrep(
    Brep=brep,
    Settings={GridMaxCount=0, GridMinCount=16, JaggedSeams=False, MaxEdgeLength=0, MinEdgeLength=0.0001, MinTolerance=0, Refine=True, RefineAngle=0, RelativeTolerance=0, SimplePlanes=True, Tolerance=0})
tetgen = Tetrahedralize(Mesh=mesh, Flags=Slider(0, range=0..10), MinRatio=Slider(1.3, range=0..10))  # -> Mesh, Indices, Points
deconstruct_mesh = DeconstructMesh(Mesh=tetgen.Mesh)  # -> Vertices, Faces, Colours, Normals
removeduplicatepts = RemoveDuplicatePts(Points=flatten(deconstruct_mesh.Vertices), Tolerance=0.01)
pdecon = Deconstruct(Point=removeduplicatepts)  # -> XComponent, YComponent, ZComponent
pdecon_2 = Deconstruct(Point=removeduplicatepts)  # -> XComponent, YComponent, ZComponent
larger_than = LargerThan(FirstNumber=pdecon.XComponent, SecondNumber="25")  # -> LargerThan, OrEqualTo
smaller = SmallerThan(FirstNumber=pdecon_2.XComponent, SecondNumber="0.1")  # -> SmallerThan, OrEqualTo
cull = CullPattern(List=removeduplicatepts, CullPattern=smaller.SmallerThan)  # -> graft(List)
cull_2 = CullPattern(List=removeduplicatepts, CullPattern=larger_than.LargerThan)  # -> graft(List)
point = Point(cull)
point_2 = Point(cull_2)
support = Point(point)
pointload = Point(point_2)
vec = VectorXYZ(XComponent=0, YComponent=0, ZComponent="-100")  # -> Vector, Length
entwine = Entwine(Branch03=support, Branch04=pointload, Branch05=vec.Vector, Branch012=graft(tetgen.Mesh), FlattenInputs=True)

number_slider = Slider(5, range=0..100)

# ---- group: Element
data = Data(0)
data_2 = Data(0)

# ---- group: Load
data_3 = Data(0)
data_4 = Data(0)

# ---- group: Cross-Section
data_5 = Data(0)
data_6 = Data(0)

# ---- group: Support
data_7 = Data(0)
data_8 = Data(0)

# ----
# Model 4
number_slider_2 = Slider(60, range=0..100)
construct_point = ConstructPoint(XCoordinate=0, YCoordinate=0, ZCoordinate=0)
construct_point_2 = ConstructPoint(XCoordinate=number_slider_2, YCoordinate=0, ZCoordinate=0)
unit_z = UnitZ(Factor=Slider(10, range=0..10))
line = Line(StartPoint=construct_point, EndPoint=construct_point_2)
move = Move(Geometry=line, Motion=unit_z)  # -> Geometry, Transform
panel = Panel(number_slider_2)
_2d_truss = _2DTruss(CurveA=line, CurveB=move.Geometry, Divisions=Slider(5, range=0..10), TrussToggle=0)  # -> PrimaryLines, BraceLines, VerticalLines, StructureNodes
pdecon_3 = Deconstruct(Point=_2d_truss.StructureNodes)  # -> XComponent, YComponent, ZComponent
pdecon_4 = Deconstruct(Point=_2d_truss.StructureNodes)  # -> XComponent, YComponent, ZComponent
equality = Equality(FirstNumber=pdecon_4.XComponent, SecondNumber=panel)  # -> Equality, Inequality
smaller_2 = SmallerThan(FirstNumber=pdecon_3.XComponent, SecondNumber="0.1")  # -> SmallerThan, OrEqualTo
merge = Merge(Data1=_2d_truss.PrimaryLines, Data2=_2d_truss.BraceLines, Data3=_2d_truss.VerticalLines)
cull_3 = CullPattern(List=_2d_truss.StructureNodes, CullPattern=equality.Equality)  # -> flatten(List)
cull_4 = CullPattern(List=_2d_truss.StructureNodes, CullPattern=smaller_2.SmallerThan)  # -> flatten(List)
vec_2 = VectorXYZ(XComponent=0, YComponent=0, ZComponent="-100")  # -> Vector, Length
pointload_2 = Point(cull_3)
support_2 = Point(cull_4)
beam = Curve(merge)
entwine_2 = Entwine(Branch01=beam, Branch03=support_2, Branch04=pointload_2, Branch05=vec_2.Vector, FlattenInputs=True)

series = Series(Start="0", Step="0.50", Count="2")

# ---- group: Material
data_9 = Data(0)
data_10 = Data(0)

# ---- group: Constraint
data_11 = Data(0)
data_12 = Data(0)

# ----
curve = Curve([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])

# ----
# Model 2
number_slider_3 = Slider(6, range=0..10)
vector_xyz = VectorXYZ(XComponent=0, YComponent=0, ZComponent=0)  # -> Vector, Length
vector_xyz_2 = VectorXYZ(XComponent=0, YComponent=0, ZComponent=number_slider_3)  # -> Vector, Length
move_2 = Move(Geometry=vector_xyz.Vector, Motion=vector_xyz_2.Vector)  # -> Geometry, Transform
line_2 = Line(StartPoint=vector_xyz.Vector, EndPoint=move_2.Geometry)
num = Number("0")
pointload_3 = Point(move_2.Geometry)
vec_3 = VectorXYZ(XComponent=0, YComponent=Slider(6, range=-20..20), ZComponent=0)  # -> Vector, Length
pointload_4 = Point(move_2.Geometry)
vec_4 = VectorXYZ(XComponent=Slider(0, range=-20..20), YComponent=0, ZComponent=0)  # -> Vector, Length
support_3 = Point(vector_xyz.Vector)
beam_2 = Curve(line_2)
columns = Curve(beam_2)
entwine_3 = Entwine(
    Branch01=beam_2,
    Branch03=support_3,
    Branch04=pointload_4,
    Branch05=vec_3.Vector,
    Branch06=columns,
    Branch07=vec_4.Vector,
    Branch010=pointload_3,
    Branch011=num,
    FlattenInputs=True)

# ----
# Model 1
number_slider_4 = Slider(10, range=0..40)
number_slider_5 = Slider(20, range=0..40)
panel_2 = Panel("2")
mesh_plane = MeshPlane(
    Boundary={Plane=PlaneXY(0, 0, 0), Size=Domain2(u=-10..10, v=-10..10)},
    WidthCount=number_slider_4,
    HeightCount=number_slider_4)  # -> Mesh, Area
shell = Mesh(mesh_plane.Mesh)
clean = CombineClean(Meshes=shell)
explode = MeshExplode(Mesh=clean, Interpolate=False)  # -> flatten(Faces)
demesh = DeconstructMesh(Mesh=clean)  # -> Vertices, Faces, Colours, Normals
area = Area(Geometry=mesh_plane.Mesh)  # -> Area, Centroid
area_2 = Area(Geometry=explode)  # -> Area, Centroid
distance = Distance(PointA=area.Centroid, PointB=area_2.Centroid)
bounds = Bounds(Numbers=distance)
nakedvertices = NakedVertices(Mesh=mesh_plane.Mesh)  # -> ClothedIndex, NakedIndex, ClothedPts, NakedPts
difference = SetDifference(SetA=demesh.Vertices, SetB=nakedvertices.NakedPts)
mc = MeshCorners(Mesh=clean, Angle=2.35619449)
deconstruct_domain = DeconstructDomain(Domain=bounds)  # -> Start, End
vec_5 = VectorXYZ(XComponent=Slider(17, range=-20..20), YComponent=Slider(20, range=-20..20), ZComponent=Slider(-100, range=-100..20))  # -> Vector, Length
maximum = Maximum(A=deconstruct_domain.Start, B=deconstruct_domain.End)
pointload_5 = Point(difference)
support_4 = Point(nakedvertices.NakedPts)
similarity = Similarity(FirstNumber=distance, SecondNumber=maximum, Threshold=Slider(1e-06, range=0..1e-06))  # -> Similarity, AbsoluteDifference
dispatch = Dispatch(List=explode, DispatchPattern=similarity.Similarity)  # -> ListA, ListB
entwine_4 = Entwine(Branch00=explode, Branch03=support_4, Branch04=pointload_5, Branch05=vec_5.Vector, FlattenInputs=True)

explode_2 = Explode(Curve=curve, Recursive=True)  # -> Segments, Vertices
unit_z_2 = UnitZ(Factor=series)
removeduplicatepts_2 = RemoveDuplicatePts(Points=flatten(explode_2.Vertices), Tolerance=0.01)
construct_domain = ConstructDomain(DomainStart=Slider(1, range=0..1), DomainEnd=Slider(8, range=0..10))
deconstruct = Deconstruct(Point=removeduplicatepts_2)  # -> XComponent, YComponent, ZComponent
vec_6 = VectorXYZ(XComponent=Slider(11, range=-20..20), YComponent=Slider(11, range=-20..20), ZComponent=0)  # -> Vector, Length
panel_3 = Panel("0.50")
smaller_than = SmallerThan(FirstNumber=deconstruct.ZComponent, SecondNumber="1")  # -> SmallerThan, OrEqualTo
series_2 = Series(Start="0", Step="0.50", Count=Slider(3, range=0..10))
list = ValueList({"Building": 0, "Shell": 1, "Cantiliver": 2, "Brick esaedro": 3, "Truss": 4, "telaio": 5, "Brick tetraedro": 6, "Building  2": 7}, selected="Building")
construct_domain_2 = ConstructDomain(DomainStart=Slider(1, range=0..1), DomainEnd=Slider(8, range=0..10))
dispatch_2 = Dispatch(List=removeduplicatepts_2, DispatchPattern=smaller_than.SmallerThan)  # -> ListA, ListB
unit_z_3 = UnitZ(Factor=series_2)
vec_7 = VectorXYZ(XComponent=Slider(11, range=-20..20), YComponent=Slider(11, range=-20..20), ZComponent=0)  # -> Vector, Length
addition = Addition(A="25", B=Slider(30, range=0..100))
vector_xyz_3 = VectorXYZ(XComponent=addition, YComponent=Slider(30, range=0..100), ZComponent=Slider(43, range=0..100))  # -> Vector, Length
point_3 = Point(vector_xyz_3.Vector)
line_3 = Line(StartPoint=cull_2, EndPoint=point_3)
item_index = ItemIndex(List=explode, Item=dispatch.ListA)
mesh_2 = Mesh(dispatch.ListA)

# ----
# UniaxialMaterial
# Elastic
file_path = FilePath("C:\GitHub\Alpaca4d\PythonScript\Pre-Processing\Material\uniAxialMaterial\ElasticUniaxialMaterial.py")
read_file = ReadFile(File=file_path, PerLineParse=False)
python = GhPythonScript(Code=read_file, MatName="S275", E="210000", G="80760", Rho="75", Fy="35")  # -> Out, UniaxialMaterial
python_2 = GhPythonScript(x=python.UniaxialMaterial)  # -> out, a
# ---------- python_2: Python ----------
a = x
# ---------- end python_2 ----------
panel_4 = Panel(python_2.a)

# ----
# UniaxialMaterial
# Elastic
panel_5 = Panel("210000")
python_3 = GhPythonScript(Code=read_file, MatName="S255", E=panel_5, G="80760", Rho="75", Fy="25")  # -> Out, UniaxialMaterial
python_4 = GhPythonScript(x=python_3.UniaxialMaterial)  # -> out, a; same code as python_2
panel_6 = Panel(python_4.a)

# ----
# nDMaterial
# ElasticIsotropic
file_path_2 = FilePath("C:\GitHub\Alpaca4d\PythonScript\Pre-Processing\Material\nDMaterial\ElasticIsotropic.py")
read_file_2 = ReadFile(File=file_path_2, PerLineParse=False)
python_5 = GhPythonScript(Code=read_file_2, MatName="S275", E="210000", G="80760", Rho="75", Fy="35")  # -> Out, NDMaterial

# ----
# Generic Cross Section
file_path_3 = FilePath("C:\GitHub\Alpaca4d\PythonScript\Pre-Processing\Section\GenericCrossSection.py")
read_file_3 = ReadFile(File=file_path_3, PerLineParse=False)
python_6 = GhPythonScript(
    Code=read_file_3,
    SectionName="Generic",
    Area="20",
    Ay="20",
    Az="20",
    Iyy="20",
    Izz="20",
    J="20",
    UniaxialMaterial=python.UniaxialMaterial)  # -> Out, CrossSection

file_path_4 = FilePath("C:\GitHub\Alpaca4d\PythonScript\Pre-Processing\Load\BeamLoad.py")

# ----
# WIP
panel_7 = Panel("100")
random = Random(Range="20", Number=panel_7, Seed=2)
random_2 = Random(Range="20", Number=panel_7, Seed="3")
pt = ConstructPoint(XCoordinate=random, YCoordinate=random_2, ZCoordinate=0)
python_7 = GhPythonScript(Pos=pt, RigidDiaphragm=Toggle(True))  # -> Out, A

# ----
# Circular CrossSection
file_path_5 = FilePath("C:\GitHub\Alpaca4d\PythonScript\Pre-Processing\Section\CircularCrossSection.py")
read_file_4 = ReadFile(File=file_path_5, PerLineParse=False)
python_8 = GhPythonScript(Code=read_file_4, SectionName="CHS", Diameter="400", Thickness="40", UniaxialMaterial=python_3.UniaxialMaterial)  # -> Out, CrossSection

# ----
# Elastic Membrane Plate Section
file_path_6 = FilePath("C:\GitHub\Alpaca4d\PythonScript\Pre-Processing\Section\ElasticMembranePlateSection.py")
read_file_5 = ReadFile(File=file_path_6, PerLineParse=False)
python_9 = GhPythonScript(Code=read_file_5, SectionName="concreteSlab", Thickness="700", NDMaterial=python_5.NDMaterial)  # -> Out, CrossSection

read_file_6 = ReadFile(File=file_path_4, PerLineParse=False)

# ----
# Rectangular Cross Section
file_path_7 = FilePath("C:\GitHub\Alpaca4d\PythonScript\Pre-Processing\Section\RectangularCrossSection.py")
read_file_7 = ReadFile(File=file_path_7, PerLineParse=False)
python_10 = GhPythonScript(Code=read_file_7, SectionName="RHS", Base="300", Height="300", UniaxialMaterial=python.UniaxialMaterial)  # -> Out, CrossSection

int = Integer(Toggle(False))
panel_8 = Panel(int)
python_11 = GhPythonScript(Force=Point(0, 0, 0), Moment=Point(0, 0, 0))  # -> flatten(LoadWrapper); inputs Force: Vector3d, Moment: Vector3d, Pos: Point3d
# ---------- python_11: Python ----------
"""Generate a point load.
    Inputs:
        Force: Input force vector [kN].
        Moment: Input moment vector [kN].
        Pos: Point to apply the loads.
    Output:
       LoadWrapper: Load element.
       """


from ghpythonlib.componentbase import executingcomponent as component
import Grasshopper, GhPython
import System
import Rhino
import rhinoscriptsyntax as rs

class MyComponent(component):
    
    def RunScript(self, Force, Moment, Pos):
        
        import Rhino.Geometry as rg
        import Grasshopper as gh
        
        def pointLoad(Force, Moment, Pos):
        
            Pos = Pos
            Force = rg.Vector3d(0,0,0) if Force is None else Force                   # Input value in kN ---> Output kN
            Moment = rg.Vector3d(0,0,0) if Moment is None else Moment                 # Input value in kNm ---> Output kNm
            loadType = "pointLoad"
        
            return [[Pos, Force, Moment, loadType]]
        
        checkData = True
        
        if Force is None:
            checkData = False
            msg = "input 'Force' failed to collect data"
            ghenv.Component.AddRuntimeMessage(gh.Kernel.GH_RuntimeMessageLevel.Warning, msg)
        
        if Moment is None:
            checkData = False
            msg = "input 'Moment' failed to collect data"
            ghenv.Component.AddRuntimeMessage(gh.Kernel.GH_RuntimeMessageLevel.Warning, msg)
        
        if Pos is None:
            checkData = False
            msg = "input 'Pos' failed to collect data"
            ghenv.Component.AddRuntimeMessage(gh.Kernel.GH_RuntimeMessageLevel.Warning, msg)
        
        
        if checkData != False:
            LoadWrapper = pointLoad(Force, Moment, Pos)
            return LoadWrapper
# ---------- end python_11 ----------
file_path_8 = FilePath("C:\GitHub\Alpaca4d\PythonScript\Pre-Processing\Element\Brick\BbarBrick.py")
read_file_8 = ReadFile(File=file_path_8, PerLineParse=False)

# ---- group: Rectangular Hollow Cross Section
file_path_9 = FilePath("C:\GitHub\Alpaca4d\PythonScript\Pre-Processing\Section\RectangularHollowCrossSection.py")
read_file_9 = ReadFile(File=file_path_9, PerLineParse=False)
python_12 = GhPythonScript(Code=read_file_9, SectionName="RHS", Base="300", Height="300", Thickness="25", UniaxialMaterial=python.UniaxialMaterial)  # -> Out, CrossSection

# ----
# doubleT CrossSection
file_path_10 = FilePath("C:\GitHub\Alpaca4d\PythonScript\Pre-Processing\Section\doubleTCrossSection.py")
read_file_10 = ReadFile(File=file_path_10, PerLineParse=False)
python_13 = GhPythonScript(
    Code=read_file_10,
    SectionName="TT",
    Bsup="300",
    Binf="600",
    H="500",
    Tsup="100",
    Tinf="100",
    Tw="100",
    UniaxialMaterial=python_3.UniaxialMaterial)  # -> Out, CrossSection

boolean_toggle = BooleanToggle(False)  # disabled
boolean_toggle_2 = BooleanToggle(True)  # disabled
boolean_toggle_3 = BooleanToggle(True)  # disabled
path = FilePath("C:\GitHub\Alpaca4d\PythonScript\Analyses\LinearAnalyses\initializeAnalysis.py")
# solver on folder Static Analyses 3ndf
# solver on folder Static Analyses
path_2 = FilePath("C:\GitHub\Alpaca4d\PythonScript\Analyses\openSees_StaticSolver_3ndf\initializeAnalysis_3ndf.py")  # disabled
# solver on folder Static Analyses
file = ReadFile(File=path, PerLineParse=False)
file_2 = ReadFile(File=path_2, PerLineParse=False)  # disabled
analyze = GhPythonScript()  # -> AlpacaStaticOutput; inputs AlpacaModel: list; disabled
# ---------- analyze: Python ----------
"""Calculate the Static Response of the structure
    Inputs:
        AlpacaModel: Assemble model to perform Static Analyses.
    Output:
       AlpacaStaticOutput: Analysed Alpaca model.
       maxDisplacement: Maximum displacement of structure [mm].
       """


from ghpythonlib.componentbase import executingcomponent as component
import Grasshopper, GhPython
import System
import Rhino
import rhinoscriptsyntax as rs

class MyComponent(component):
    
    def RunScript(self, AlpacaModel):
        
        
        import System
        import os
        import Grasshopper as gh
        
        def InitializeStaticAnalysis(AlpacaModel):
            
            ghFilePath = ghenv.Component.Attributes.Owner.OnPingDocument().FilePath
            workingDirectory = os.path.dirname(ghFilePath) 
            outputFileName = 'openSeesOutputWrapper.txt'
        
            for dirpath, dirnames, filenames in os.walk(workingDirectory):
                for filename in filenames:
                    if filename == outputFileName:
                        file = os.path.join(dirpath,outputFileName)
                        os.remove(file)
        
        
        
            ghFolderPath = os.path.dirname(ghFilePath)
            outputFolder = os.path.join(ghFolderPath,'assembleData')
            wrapperFile = os.path.join( outputFolder,'openSeesModel.txt' )
        
            userObjectFolder = gh.Folders.DefaultUserObjectFolder
            pythonInterpreter = os.path.join(userObjectFolder, r'Alpaca4d\Analyses\WPy64\scripts\winpython.bat')
            fileName = os.path.join(userObjectFolder, r'Alpaca4d\Analyses\LinearAnalyses\openSees_StaticSolver.py')
            
            wrapperFile = '"' + wrapperFile + '"'
            fileName = '"' + fileName + '"'
            
            p = System.Diagnostics.Process()
            p.StartInfo.RedirectStandardOutput = True
            p.StartInfo.RedirectStandardError = True
        
            p.StartInfo.UseShellExecute = False
            p.StartInfo.CreateNoWindow = True
            
            p.StartInfo.FileName = pythonInterpreter
            p.StartInfo.Arguments = fileName + " " + wrapperFile
            p.Start()
            p.WaitForExit()
            
            
            msg = p.StandardError.ReadToEnd()
            ghenv.Component.AddRuntimeMessage(gh.Kernel.GH_RuntimeMessageLevel.Error, msg)
        
        
            ## READ THE OUTPUT FROM THE OPEENSEES_SOLVER
            ## THE ORDER MUST BE THE SAME OF THE OUTPUT LIST IN OpenSeesStaticSolver.py
        
            outputFile = os.path.join(outputFolder, outputFileName)
        
            with open(outputFile, 'r') as f:
                lines = f.readlines()
                nodeDisplacementWrapper = eval( lines[0].strip() )
                reactionWrapper = eval( lines[1].strip() )
                elementOutputWrapper = eval( lines[2].strip() )
                elementLoadWrapper = eval( lines[3].strip() )
                eleForceWrapper = eval( lines[4].strip() )
        
        
            AlpacaLinearStaticOutput = ([nodeDisplacementWrapper,
                                    reactionWrapper,
                                    elementOutputWrapper,
                                    elementLoadWrapper,
                                    eleForceWrapper])
        
            return AlpacaLinearStaticOutput
        
        
        checkData = True
        
        if not AlpacaModel:
            checkData = False
            msg = "input 'AlpacaModel' failed to collect data"
            ghenv.Component.AddRuntimeMessage(gh.Kernel.GH_RuntimeMessageLevel.Warning, msg)
        
        
        if checkData != False:
            AlpacaStaticOutput = InitializeStaticAnalysis(AlpacaModel)
            #maxDisplacement = None
            return AlpacaStaticOutput
# ---------- end analyze ----------
analyze_2 = GhPythonScript()  # -> AlpacaModalOutput, Frequency, Period; disabled
panel_9 = Panel("0.005")  # disabled
panel_10 = Panel(path)
# we can skip some data point. We don't need to read all of them. This can help to make it faster.
# 
# OR
# 
# We can read ALL the files and show only some output.
panel_11 = Panel("1")  # disabled
path_3 = FilePath("C:\GitHub\Alpaca4d\PythonScript\Post-Processing\viewGroundAccAnalyses\viewGroundAccAnalyses.py")  # disabled
file_3 = ReadFile(File=path_3, PerLineParse=False)  # disabled

# ----
# Brick component
list_2 = ValueList({"8Color": 0, "20Color": 1}, selected="20Color")  # disabled

# ----
# Disp Numerical Ouput
# OK!
number_slider_6 = Slider(10, range=0..10)  # disabled
file_path_11 = FilePath("C:\GitHub\Alpaca4d\PythonScript\Post-Processing\beamDisp\beamDisp.py")  # disabled
file_path_12 = FilePath("C:\GitHub\Alpaca4d\PythonScript\Post-Processing\nodalDisp\nodalDisp.py")  # disabled
file_path_13 = FilePath("C:\GitHub\Alpaca4d\PythonScript\Post-Processing\brickDisp\brickDisp.py")  # disabled
file_path_14 = FilePath("C:\GitHub\Alpaca4d\PythonScript\Post-Processing\shellDisp\shellDisp.py")  # disabled
read_file_11 = ReadFile(File=file_path_11, PerLineParse=False)  # disabled
read_file_12 = ReadFile(File=file_path_14, PerLineParse=False)  # disabled
read_file_13 = ReadFile(File=file_path_12, PerLineParse=False)  # disabled
read_file_14 = ReadFile(File=file_path_13, PerLineParse=False)  # disabled

mesh_plane_2 = MeshPlane(
    Boundary={Plane=PlaneXY(0, 0, 0), Size=Domain2(u=-10..10, v=-10..10)},
    WidthCount=Slider(3, range=0..100),
    HeightCount=Slider(3, range=0..100))  # -> Mesh, Area
number_slider_7 = Slider(10, range=0..100)
subtraction = Subtraction(A=number_slider_7, B="1")
deconstruct_mesh_2 = DeconstructMesh(Mesh=mesh_plane_2.Mesh)  # -> Vertices, Faces, Colours, Normals
series_3 = Series(Start="0", Step="3", Count=number_slider_7)
series_4 = Series(Start="3", Step="3", Count=subtraction)
removeduplicatepts_3 = RemoveDuplicatePts(Points=flatten(deconstruct_mesh_2.Vertices), Tolerance=0.01)
unit_z_4 = UnitZ(Factor=series_3)
unit_z_5 = UnitZ(Factor=series_4)
move_3 = Move(Geometry=graft(removeduplicatepts_3), Motion=unit_z_4)  # -> simplify(Geometry), Transform
move_4 = Move(Geometry=graft(mesh_plane_2.Mesh), Motion=unit_z_5)  # -> Geometry, Transform
shift_list = ShiftList(List=move_3.Geometry, Shift=1, Wrap=True)
deconstruct_mesh_3 = DeconstructMesh(Mesh=move_4.Geometry)  # -> Vertices, Faces, Colours, Normals
removeduplicatepts_4 = RemoveDuplicatePts(Points=flatten(deconstruct_mesh_3.Vertices), Tolerance=0.01)
pdecon_5 = Deconstruct(Point=removeduplicatepts_4)  # -> XComponent, YComponent, ZComponent
larger_than_2 = LargerThan(FirstNumber=pdecon_5.XComponent, SecondNumber="9")  # -> LargerThan, OrEqualTo
mesh_explode = MeshExplode(Mesh=move_4.Geometry, Interpolate=False)
vincoli = Point(removeduplicatepts_3)
cull_5 = CullPattern(List=removeduplicatepts_4, CullPattern=larger_than_2.LargerThan)  # -> flatten(List)
vec_8 = VectorXYZ(XComponent="-100", YComponent=0, ZComponent=0)  # -> Vector, Length
pointload_6 = Point(cull_5)
support_5 = Point(vincoli)

cull_nth = CullNth(List=simplify(shift_list), CullFrequency=number_slider_7)
cull_nth_2 = CullNth(List=simplify(move_3.Geometry), CullFrequency=number_slider_7)
refine = Refine(Mesh=mesh_explode, Level="0")
mesh_explode_2 = MeshExplode(Mesh=refine, Interpolate=False)

line_4 = Line(StartPoint=cull_nth_2, EndPoint=cull_nth)  # -> flatten(Line)
colonne = RemoveDuplicateLines(Lines=line_4, Tolerance=0.01)
entwine_5 = Entwine(
    Branch00=mesh_explode_2,
    Branch01=colonne,
    Branch03=support_5,
    Branch04=pointload_6,
    Branch05=vec_8.Vector,
    FlattenInputs=True)

rectangle = Rectangle(Plane=PlaneXY(0, 0, 0), XSize="10", YSize="20", Radius=0)  # -> Rectangle, Length
mesh_surface = MeshSurface(Surface=rectangle.Rectangle, UCount=number_slider, VCount=number_slider, Overhang=True, Equalize=False)
weaverbird_s_offset_mesh = WeaverbirdsOffsetMesh(MeshCurves=mesh_surface, Distance=graft(series), OffsetType=0)
entwine_6 = Entwine(Branch00=mesh_surface, Branch01=weaverbird_s_offset_mesh, FlattenInputs=True)
subtraction_2 = Subtraction(A="10", B="1")
vec_9 = VectorXYZ(XComponent=0, YComponent=0, ZComponent="-100")  # -> Vector, Length

move_5 = Move(Geometry=mesh_surface, Motion=unit_z_2)  # -> flatten(Geometry), Transform

# ---- group: brith to loft mesh
ghpython_script = GhPythonScript(MeshSeries=move_5.Geometry, color=ColourSwatch(SwatchColor=RGB(4, 0, 255)))  # -> out, simplify(flatten(Brick)); inputs MeshSeries: list of Mesh
# ---------- ghpython_script: Python ----------
import Rhino.Geometry as rg

def MeshToShell(Mesh):
    
    Mesh.Unweld(0, True)
    mesh = Mesh.ExplodeAtUnweldedEdges()
    newMesh = []
    elementType = []
    for explodedMesh in mesh:
        newMesh.append(explodedMesh)
    return newMesh 

def brick( MeshList, color ):
    meshExpl = []
    Vertix = []
    elementType = []
    solid = []
    
    for Mesh in MeshList:
        shellWrapper = MeshToShell(Mesh)
        meshExpl.append( shellWrapper )
    for index1 in range(0, len(MeshList)-1):
        for index2 in range(0, len(meshExpl[0])):
            if meshExpl[ index1 ][ index2 ].Vertices.Count == 4:
                
                elementType.append("stdBrick")
                vertix1 = meshExpl[ index1 ][ index2 ].Vertices[0]
                vertix2 = meshExpl[ index1 ][ index2 ].Vertices[1]
                vertix3 = meshExpl[ index1 ][ index2 ].Vertices[2]
                vertix4 = meshExpl[ index1 ][ index2 ].Vertices[3]
                vertix5 = meshExpl[index1 + 1 ][ index2].Vertices[0]
                vertix6 = meshExpl[index1 + 1 ][ index2].Vertices[1]
                vertix7 = meshExpl[index1 + 1 ][ index2].Vertices[2]
                vertix8 = meshExpl[index1 + 1 ][ index2].Vertices[3]
                
                vertix = [ vertix1, vertix2, vertix3, vertix4,
                vertix5, vertix6, vertix7, vertix8 ]
                
                ele = rg.Mesh()
                
                ele.Vertices.Add( vertix1 ) # 0 
                ele.Vertices.Add( vertix2 ) # 1
                ele.Vertices.Add( vertix3 ) # 2
                ele.Vertices.Add( vertix4 ) # 3
                ele.Vertices.Add( vertix5 ) # 4
                ele.Vertices.Add( vertix6 ) # 5
                ele.Vertices.Add( vertix7 ) # 6
                ele.Vertices.Add( vertix8 ) # 7
                
                ele.VertexColors.Add(color)
                ele.VertexColors.Add(color)
                ele.VertexColors.Add(color)
                ele.VertexColors.Add(color)
                ele.VertexColors.Add(color)
                ele.VertexColors.Add(color)
                ele.VertexColors.Add(color)
                ele.VertexColors.Add(color)
    
                
                ele.Faces.AddFace(0, 1, 2, 3) # 0
                ele.Faces.AddFace(4, 5, 6, 7) # 1
                ele.Faces.AddFace(0, 1, 5, 4) # 2
                ele.Faces.AddFace(3, 2, 6, 7) # 3
                ele.Faces.AddFace(1, 5, 6, 2) # 4
                ele.Faces.AddFace(0, 4, 7, 3) # 5
                #ele.IsClosed()
                
            else :
                elementType.append(["FourNodeTetrahedron"]*3)
                
                if meshExpl[ index1 ][ index2 ].Vertices[0] == meshExpl[index1 + 1 ][ index2].Vertices[0] :
                    vertix1 = meshExpl[ index1 ][ index2 ].Vertices[0]
                    vertix2 = meshExpl[ index1 ][ index2 ].Vertices[1]
                    vertix3 = meshExpl[ index1 ][ index2 ].Vertices[2]
                    vertix4 = meshExpl[index1 + 1 ][ index2].Vertices[1]
                    vertix5 = meshExpl[index1 + 1 ][ index2].Vertices[2]
                    
                    vertixEle1 = [ vertix1, vertix2, vertix3, vertix4 ]
                    vertixEle2 = [ vertix1, vertix2, vertix3, vertix2 ]
                    
                    ele1 = rg.Mesh() # Tetrahedron 1
                    ele2 = rg.Mesh() # Tetrahedron 2
                    
                    ele1.Vertices.Add( vertix1 ) # 0 
                    ele1.Vertices.Add( vertix2 ) # 1
                    ele1.Vertices.Add( vertix3 ) # 2 
                    ele1.Vertices.Add( vertix4 ) # 3 
                    
                    ele1.VertexColors.Add(color)
                    ele1.VertexColors.Add(color)
                    ele1.VertexColors.Add(color)
                    ele1.VertexColors.Add(color)
                    
                    ele2.Vertices.Add( vertix1 ) # 0 
                    ele2.Vertices.Add( vertix2 ) # 1 
                    ele2.Vertices.Add( vertix3 ) # 2 
                    ele2.Vertices.Add( vertix2 ) # 3
    
                    ele2.VertexColors.Add(color)
                    ele2.VertexColors.Add(color)
                    ele2.VertexColors.Add(color)
                    ele2.VertexColors.Add(color)
                    
                    ele1.Faces.AddFace(0, 1, 4 ) # 0
                    ele1.Faces.AddFace(0, 1, 3 ) # 1
                    ele1.Faces.AddFace(0, 4, 3 ) # 2
                    ele1.Faces.AddFace(1, 3, 4 ) # 3
                    
                    ele2.Faces.AddFace(0, 1, 3 ) # 0
                    ele2.Faces.AddFace(0, 1, 2 ) # 1
                    ele2.Faces.AddFace(1, 2, 3 ) # 2
                    ele2.Faces.AddFace(0, 2, 3 ) # 3
                    
                    ele = [ ele1, ele2 ]
                    
                else :
                
                    vertix1 = meshExpl[ index1 ][ index2 ].Vertices[0]
                    vertix2 = meshExpl[ index1 ][ index2 ].Vertices[1]
                    vertix3 = meshExpl[ index1 ][ index2 ].Vertices[2]
                    vertix4 = meshExpl[index1 + 1 ][ index2].Vertices[0]
                    vertix5 = meshExpl[index1 + 1 ][ index2].Vertices[1]
                    vertix6 = meshExpl[index1 + 1 ][ index2].Vertices[2]
                    
                    vertixEle1 = [ vertix1, vertix2, vertix3, vertix6 ]
                    vertixEle2 = [ vertix4, vertix5, vertix6, vertix1 ]
                    vertixEle3 = [ vertix5, vertix6, vertix2, vertix1 ]
                    
                    vertix = [ vertixEle1, vertixEle2, vertixEle3 ]
                    
                    ele1 = rg.Mesh() # Tetrahedron 1
                    ele2 = rg.Mesh() # Tetrahedron 2
                    ele3 = rg.Mesh() # Tetrahedron 3
                    
                    ele1.Vertices.Add( vertix1 ) # 0 
                    ele1.Vertices.Add( vertix2 ) # 1
                    ele1.Vertices.Add( vertix3 ) # 2 
                    ele1.Vertices.Add( vertix6 ) # 3 
                    
                    ele1.VertexColors.Add(color)
                    ele1.VertexColors.Add(color)
                    ele1.VertexColors.Add(color)
                    ele1.VertexColors.Add(color)
                    
                    ele2.Vertices.Add( vertix4 ) # 0 
                    ele2.Vertices.Add( vertix5 ) # 1 
                    ele2.Vertices.Add( vertix6 ) # 2 
                    ele2.Vertices.Add( vertix1 ) # 3
    
                    ele2.VertexColors.Add(color)
                    ele2.VertexColors.Add(color)
                    ele2.VertexColors.Add(color)
                    ele2.VertexColors.Add(color)
                    
                    ele3.Vertices.Add( vertix5 ) # 0 
                    ele3.Vertices.Add( vertix6 ) # 1 
                    ele3.Vertices.Add( vertix2 ) # 2 
                    ele3.Vertices.Add( vertix1 ) # 3
                    
                    ele3.VertexColors.Add(color)
                    ele3.VertexColors.Add(color)
                    ele3.VertexColors.Add(color)
                    ele3.VertexColors.Add(color)
                    
                    ele1.Faces.AddFace(0, 1, 2 ) # 0
                    ele1.Faces.AddFace(0, 3, 1 ) # 1
                    ele1.Faces.AddFace(0, 3, 2 ) # 2
                    ele1.Faces.AddFace(1, 3, 2 ) # 3
                    
                    ele2.Faces.AddFace(0, 1, 2 ) # 0
                    ele2.Faces.AddFace(0, 3, 1 ) # 1
                    ele2.Faces.AddFace(0, 3, 2 ) # 2
                    ele2.Faces.AddFace(1, 3, 2 ) # 3
                    
                    ele3.Faces.AddFace(0, 1, 2 ) # 0
                    ele3.Faces.AddFace(0, 3, 1 ) # 1
                    ele3.Faces.AddFace(0, 3, 2 ) # 2
                    ele3.Faces.AddFace(1, 3, 2 ) # 3
                    
                    ele = [ ele1, ele2, ele3 ]
            
            solid.append(ele)
            Vertix.append( vertix )
    return solid, elementType

Brick, type = brick( MeshSeries, color )
# ---------- end ghpython_script ----------

# ----
move_6 = Move(Geometry=graft(ghpython_script.Brick), Motion=unit_z_3)  # -> flatten(Geometry), Transform

# ----
# Model 0
number_slider_8 = Slider(-20, range=-20..20)
vec_10 = VectorXYZ(XComponent=number_slider_8, YComponent=0, ZComponent=0)  # -> Vector, Length
pointload_7 = Point([Point(0, 0, 10), Point(5, 0, 10), Point(0, 5, 5), Point(0, 5, 10), Point(0, 0, 5)])
vec_11 = VectorXYZ(XComponent=Slider(0, range=-20..20), YComponent=0, ZComponent=0)  # -> Vector, Length
support_6 = Point([Point(0, 0, 0), Point(5, 0, 0), Point(10, 0, 0), Point(15, 0, 0), Point(15, 5, 0), Point(10, 5, 0), Point(5, 5, 0), Point(0, 5, 0)])
shell_2 = Mesh([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])
beam_3 = Curve([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])
truss = Curve([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])
cantiliver = Curve([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])
columns_2 = Curve([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])
vec_12 = VectorXYZ(XComponent=0, YComponent=Slider(11, range=-20..20), ZComponent=0)  # -> Vector, Length
refine_2 = Refine(Mesh=shell_2, Level="2")
mesh_3 = Mesh(refine_2)
clean_2 = CombineClean(Meshes=mesh_3)
explode_3 = MeshExplode(Mesh=clean_2, Interpolate=False)  # -> flatten(Faces)

list_length = ListLength(List=pointload_7)
range = Range(Domain=construct_domain, Steps=list_length)
multiplication = Multiplication(A=vec_6.Vector, B=range)
custom_preview = CustomPreview(Geometry=support_6, Material=ColourSwatch(SwatchColor=RGB(0, 0, 0)))

entwine_7 = Entwine(
    Branch00=explode_3,
    Branch01=beam_3,
    Branch02=truss,
    Branch03=support_6,
    Branch04=pointload_7,
    Branch05=vec_10.Vector,
    Branch06=columns_2,
    Branch07=vec_11.Vector,
    Branch08=cantiliver,
    Branch09=vec_12.Vector,
    Branch010=pointload_7,
    Branch011=multiplication,
    FlattenInputs=True)

# ----
# Model 5
number_slider_9 = Slider(-20, range=-20..20)
vec_13 = VectorXYZ(XComponent=number_slider_9, YComponent=0, ZComponent=0)  # -> Vector, Length
vec_14 = VectorXYZ(XComponent=Slider(0, range=-20..20), YComponent=0, ZComponent=0)  # -> Vector, Length
beam_4 = Curve(curve)
pointload_8 = Point(dispatch_2.ListB)
support_7 = Point(dispatch_2.ListA)

list_length_2 = ListLength(List=pointload_8)
range_2 = Range(Domain=construct_domain_2, Steps=list_length_2)
multiplication_2 = Multiplication(A=vec_7.Vector, B=range_2)

entwine_8 = Entwine(
    Branch01=beam_4,
    Branch03=support_7,
    Branch04=pointload_8,
    Branch05=vec_13.Vector,
    Branch07=vec_14.Vector,
    Branch010=pointload_8,
    Branch011=multiplication_2,
    FlattenInputs=True)

deconstruct_mesh_4 = DeconstructMesh(Mesh=ghpython_script.Brick)  # -> Vertices, Faces, Colours, Normals
ghpython_script_2 = GhPythonScript(x=ghpython_script.Brick)  # -> out, flatten(a); same code as python_2
removeduplicatepts_5 = RemoveDuplicatePts(Points=flatten(deconstruct_mesh_4.Vertices), Tolerance=0.01)
pdecon_6 = Deconstruct(Point=removeduplicatepts_5)  # -> XComponent, YComponent, ZComponent
smaller_3 = SmallerThan(FirstNumber=pdecon_6.XComponent, SecondNumber="0.1")  # -> SmallerThan, OrEqualTo
larger_than_3 = LargerThan(FirstNumber=pdecon_6.XComponent, SecondNumber=subtraction_2)  # -> LargerThan, OrEqualTo
cull_6 = CullPattern(List=removeduplicatepts_5, CullPattern=smaller_3.SmallerThan)  # -> graft(List)
cull_7 = CullPattern(List=removeduplicatepts_5, CullPattern=larger_than_3.LargerThan)  # -> graft(List)
point_4 = Point(cull_7)
pointload_9 = Point(point_4)
support_8 = Point(cull_6)
entwine_9 = Entwine(Branch03=support_8, Branch04=pointload_9, Branch05=vec_9.Vector, Branch012=ghpython_script.Brick, FlattenInputs=True)

dispatch_3 = Dispatch(List=removeduplicatepts_5, DispatchPattern=smaller_3.SmallerThan)  # -> ListA, ListB

point_5 = Point(dispatch_3.ListA)

stream_filter = StreamFilter(
    Gate=list,
    Stream0=entwine_7,
    Stream1=entwine_4,
    Stream2=entwine_3,
    Stream3=entwine_9,
    Stream4=entwine_2,
    Stream5=entwine_8,
    Stream6=entwine,
    Stream7=entwine_5)
explode_tree = ExplodeTree(Data=stream_filter)  # -> Branch0, Branch1, Branch2, Branch3, Branch4, Branch5, Branch6, Branch7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

pointload_10 = Point(explode_tree.Branch4)
vector = Data(explode_tree.Branch5)

support_9 = Point(explode_tree.Branch3)
shell_3 = Mesh(explode_tree.Branch0)
beam_5 = Curve(explode_tree.Branch1)
truss_2 = Curve(explode_tree.Branch2)

data_13 = Data(explode_tree.Branch6)
vector_2 = Data(explode_tree.Branch7)

data_14 = Data(explode_tree.Branch8)
vector_3 = Data(explode_tree.Branch9)

data_15 = Data(explode_tree.Branch10)
mass = Data(explode_tree.Branch11)

brick = Data(explode_tree.Branch12)

# ----
# Support
file_path_15 = FilePath("C:\GitHub\Alpaca4d\PythonScript\Pre-Processing\Element\Support\Support.py")
toggle = BooleanToggle(True)
read_file_15 = ReadFile(File=file_path_15, PerLineParse=False)
point_6 = Point(support_9)
python_14 = GhPythonScript(Code=read_file_15, Pos=graft(point_6), Tx=toggle, Ty=Toggle(True), Tz=toggle, Rx=toggle, Ry=toggle, Rz=toggle)  # -> Out, flatten(SupportWrapper)
python_15 = GhPythonScript(x=python_14.SupportWrapper)  # -> out, a; same code as python_2
panel_12 = Panel(python_15.a)

# ----
# Linear Load
value_list = ValueList({"LocalAxis": 0, "GlobalAxis": 1}, selected="GlobalAxis")
vector_4 = Vector(vector_2)
crv = Curve(data_13)
python_16 = GhPythonScript(Code=read_file_6, Force=vector_4, Element=crv, Orientation=value_list)  # -> Out, flatten(BeamUniformLoad)

# ----
# Linear Load
value_list_2 = ValueList({"LocalAxis": 0, "GlobalAxis": 1}, selected="GlobalAxis")
vector_5 = Vector(vector_3)
crv_2 = Curve(data_14)
python_17 = GhPythonScript(Code=read_file_6, Force=vector_5, Element=crv_2, Orientation=value_list_2)  # -> Out, flatten(BeamUniformLoad)

# ----
# Point Load
file_path_16 = FilePath("C:\GitHub\Alpaca4d\PythonScript\Pre-Processing\Load\PointLoad.py")
read_file_16 = ReadFile(File=file_path_16, PerLineParse=False)
vector_6 = Vector(expr("x*0", Vector(2.518385542, -6.656153768, 0)))
vector_7 = Vector(vector)
point_7 = Point(pointload_10)
python_18 = GhPythonScript(Code=read_file_16, Force=vector_7, Moment=vector_6, Pos=point_7)  # -> Out, flatten(LoadWrapper)

# ----
# MassLoad
num_2 = Number(mass)
pt_2 = Point(data_15)
path_4 = FilePath("C:\GitHub\Alpaca4d\PythonScript\Pre-Processing\Load\MassLoad.py")
file_4 = ReadFile(File=path_4, PerLineParse=False)
python_19 = GhPythonScript(Code=file_4, NodalMass=num_2, Pos=pt_2)  # -> Out, flatten(Mass)

# ----
# meshToShell
mesh_4 = Mesh(shell_3)
file_path_17 = FilePath("C:\GitHub\Alpaca4d\PythonScript\Pre-Processing\Element\MeshToShell\MeshToShell.py")
read_file_17 = ReadFile(File=file_path_17, PerLineParse=False)
python_20 = GhPythonScript(Code=read_file_17, Mesh=mesh_4, CrossSection=python_9.CrossSection)  # -> Out, flatten(ShellWrapper)

crv_3 = Curve(truss_2)

# ----
# LineToBeam
file_path_18 = FilePath("C:\GitHub\Alpaca4d\PythonScript\Pre-Processing\Element\LineToBeam\LineToBeam.py")
read_file_18 = ReadFile(File=file_path_18, PerLineParse=False)
crv_4 = Curve(beam_5)
python_21 = GhPythonScript(Code=read_file_18, Line=crv_4, CrossSection=python_13.CrossSection)  # -> Out, flatten(BeamWrapper)

data_16 = Data([python_16.BeamUniformLoad, python_17.BeamUniformLoad, python_18.LoadWrapper])

# ----
# LineToTruss
list_3 = ValueList({"Truss": 0, "Beam": 1}, selected="Truss")
swatch = ColourSwatch(SwatchColor=RGB(255, 200, 0))
python_22 = GhPythonScript(Code=read_file_18, Line=crv_3, CrossSection=python_8.CrossSection, OrientSection="0", BeamType=list_3)  # -> Out, flatten(BeamWrapper)

# ----
# Solid
swatch_2 = ColourSwatch(SwatchColor=RGB(0, 72, 255))
python_23 = GhPythonScript(Code=read_file_8, Brick=brick, Colour=swatch_2, NDMaterial=python_5.NDMaterial)  # -> Out, flatten(SolidWrapper)

item = ListItem(List=python_23.SolidWrapper, Index=0, Wrap=True)  # -> Item, Item1
python_24 = GhPythonScript(x=item.Item)  # -> out, simplify(a); same code as python_2
python_25 = GhPythonScript(x=python_24.a)  # -> out, simplify(a); same code as python_2
python_26 = GhPythonScript(x=python_25.a)  # -> out, simplify(a); same code as python_2
merge_2 = Merge(Data1=python_20.ShellWrapper, Data2=python_21.BeamWrapper, Data3=python_22.BeamWrapper, Data4=python_23.SolidWrapper)
panel_13 = Panel(python_26.a)
clean_tree = CleanTree(RemoveNulls=True, RemoveInvalid=True, RemoveEmpty=False, Tree=merge_2)
clean_tree_2 = CleanTree(RemoveNulls=True, RemoveInvalid=True, RemoveEmpty=False, Tree=python_14.SupportWrapper)
clean_tree_3 = CleanTree(RemoveNulls=True, RemoveInvalid=True, RemoveEmpty=False, Tree=data_16)
clean_tree_4 = CleanTree(RemoveNulls=True, RemoveInvalid=True, RemoveEmpty=False, Tree=python_19.Mass)

# ----
# Assemble
file_path_19 = FilePath("C:\GitHub\Alpaca4d\PythonScript\Pre-Processing\Assemble\Assemble.py")
read_file_19 = ReadFile(File=file_path_19, PerLineParse=False)
python_27 = GhPythonScript(
    Code=read_file_19,
    Element=flatten(clean_tree),
    Support=flatten(clean_tree_2),
    Load=flatten(clean_tree_3),
    Mass=flatten(clean_tree_4))  # -> Out, AlpacaModel, MassOfStructure

panel_14 = Panel(python_27.MassOfStructure)  # disabled
data_17 = Data(python_27.AlpacaModel)  # disabled

# ----
# modelView
# da fare a cluster
# OK!
file_path_20 = FilePath("C:\GitHub\Alpaca4d\PythonScript\Post-Processing\modelView\modelView.py")  # disabled
boolean_toggle_4 = BooleanToggle(False)  # disabled
read_file_20 = ReadFile(File=file_path_20, PerLineParse=False)  # disabled
python_28 = GhPythonScript(
    Code=read_file_20,
    AlpacaModel=data_17,
    ModelExstrud=boolean_toggle,
    Load=boolean_toggle_4,
    Support=boolean_toggle_2,
    NodalMass=boolean_toggle_3)  # -> ModelView, LineModel, ForceDisplay, Support, LocalAxis, TagNode, TagEle, Mass; disabled
explode_tree_2 = ExplodeTree(Data=python_28.LocalAxis)  # -> Branch0, Branch1, Branch2, Branch3; disabled
explode_tree_3 = ExplodeTree(Data=python_28.LineModel)  # -> Branch0, Branch1; disabled
number_slider_10 = Slider(3, range=0..10)  # disabled
geo = Geometry(python_28.ModelView)  # disabled
geo_2 = Geometry(geo)  # disabled
explode_tree_4 = ExplodeTree(Data=simplify(python_28.TagNode))  # -> Branch0, Branch1; disabled
explode_tree_5 = ExplodeTree(Data=simplify(python_28.TagEle))  # -> Branch0, Branch1; disabled
explode_tree_6 = ExplodeTree(Data=simplify(python_28.Mass))  # -> Branch0, Branch1; disabled
colour_swatch = ColourSwatch(SwatchColor=RGB(164, 252, 0))  # disabled
colour_swatch_2 = ColourSwatch(SwatchColor=RGB(176, 32, 32))  # disabled
colour_swatch_3 = ColourSwatch(SwatchColor=RGB(107, 106, 102))  # disabled
colour_swatch_4 = ColourSwatch(SwatchColor=RGB(252, 0, 0))  # disabled
explode_tree_7 = ExplodeTree(Data=python_28.ForceDisplay)  # -> Branch0, Branch1; disabled
colour_swatch_5 = ColourSwatch(SwatchColor=RGB(255, 0, 0))  # disabled
colour_swatch_6 = ColourSwatch(SwatchColor=RGB(0, 245, 53))  # disabled
colour_swatch_7 = ColourSwatch(SwatchColor=RGB(0, 55, 255))  # disabled
colour_swatch_8 = ColourSwatch(SwatchColor=RGB(25, 0, 255))  # disabled
curve_direction = GhPythonScript(Crv=explode_tree_3.Branch0, Thickness=number_slider_10, RGB=explode_tree_3.Branch1)  # -> out; inputs Crv: list of Curve, RGB: list of Color; disabled
# ---------- curve_direction: Python ----------
from ghpythonlib.componentbase import executingcomponent as component
import Grasshopper, GhPython
import System
import Rhino as rh
import rhinoscriptsyntax as rs
import Rhino.Geometry as rg


class CurveColor(component):

    def RunScript(self,Crv,Thickness,RGB):
        self.C = Crv
        self.RGB = RGB
        self.t = Thickness
        if not self.C: return
            
    def DrawViewportWires(self,arg):
        if not  self.C: return
        for curve, color in zip( self.C, self.RGB ):
            arg.Display.DrawCurve(curve, color,self.t)
# ---------- end curve_direction ----------
custom_preview_2 = CustomPreview(Geometry=python_28.Support, Material=colour_swatch)  # disabled
vector_display_ex = VectorDisplayEx(Point=explode_tree_7.Branch0, Vector=explode_tree_7.Branch1, Colour=colour_swatch_2, Width=2)  # disabled
vector_display_ex_2 = VectorDisplayEx(Point=explode_tree_2.Branch0, Vector=explode_tree_2.Branch1, Colour=colour_swatch_4, Width=2)  # disabled
vector_display_ex_3 = VectorDisplayEx(Point=explode_tree_2.Branch0, Vector=explode_tree_2.Branch2, Colour=colour_swatch_6, Width=2)  # disabled
vector_display_ex_4 = VectorDisplayEx(Point=explode_tree_2.Branch0, Vector=explode_tree_2.Branch3, Colour=colour_swatch_7, Width=2)  # disabled
dot_display = DotDisplay(Point=explode_tree_6.Branch0, Colour=colour_swatch_3, Size=explode_tree_6.Branch1)  # disabled
tag = TextTag(Location=explode_tree_4.Branch0, Text=explode_tree_4.Branch1, Colour=colour_swatch_5)  # disabled
tag_2 = TextTag(Location=explode_tree_5.Branch0, Text=explode_tree_5.Branch1, Colour=colour_swatch_8)  # disabled

data_18 = Data(python_27.AlpacaModel)  # disabled

# ----
# Modal Analyses
path_5 = FilePath("C:\GitHub\Alpaca4d\PythonScript\Analyses\DynamicAnalysis\initializeModalAnalyses.py")  # disabled
panel_15 = Panel("5")  # disabled
file_5 = ReadFile(File=path_5, PerLineParse=False)  # disabled
analyze_3 = GhPythonScript(Code=file_5, AlpacaModel=data_18, NumVibrationModes=panel_15)  # -> Out, AlpacaModalOutput, Frequency, Period; disabled

data_19 = Data(python_27.AlpacaModel)  # disabled
analyze_4 = GhPythonScript(Code=file, AlpacaModel=python_27.AlpacaModel)  # -> Out, AlpacaStaticOutput, MaxDisplacement
analyze_5 = GhPythonScript(Code=file_2, AlpacaModel=python_27.AlpacaModel)  # -> Out, AlpacaStaticOutput; disabled
analyze_6 = GhPythonScript(AlpacaModel=python_27.AlpacaModel)  # -> out, AlpacaStaticOutput, maxDisplacement; inputs AlpacaModel: list
# ---------- analyze_6: Python ----------
"""Calculate the Static Response of the structure
    Inputs:
        AlpacaModel: Assemble model to perform Static Analyses.
    Output:
       AlpacaStaticOutput: Analysed Alpaca model.
       maxDisplacement: Maximum displacement of structure [mm].
       """


import System
import os
import Grasshopper as gh

def InitializeStaticAnalysis(AlpacaModel):
    
    ghFilePath = ghenv.Component.Attributes.Owner.OnPingDocument().FilePath
    workingDirectory = os.path.dirname(ghFilePath) 
    outputFileName = 'openSeesOutputWrapper.txt'

    for dirpath, dirnames, filenames in os.walk(workingDirectory):
        for filename in filenames:
            if filename == outputFileName:
                file = os.path.join(dirpath,outputFileName)
                os.remove(file)



    ghFolderPath = os.path.dirname(ghFilePath)
    outputFolder = os.path.join(ghFolderPath,'assembleData')
    wrapperFile = os.path.join( outputFolder,'openSeesModel.txt' )

    userObjectFolder = gh.Folders.DefaultUserObjectFolder
    pythonInterpreter = os.path.join(userObjectFolder, r'Alpaca4d\Analyses\WPy64\scripts\winpython.bat')
    fileName = os.path.join(userObjectFolder, r'Alpaca4d\Analyses\LinearAnalyses\openSees_StaticSolver.py')
    
    fileName = '"' + fileName + '"'
    wrapperFile = '"' + wrapperFile + '"'

    
    p = System.Diagnostics.Process()
    p.StartInfo.RedirectStandardOutput = True
    p.StartInfo.RedirectStandardError = True

    p.StartInfo.UseShellExecute = False
    p.StartInfo.CreateNoWindow = True
    
    p.StartInfo.FileName = pythonInterpreter
    p.StartInfo.Arguments = fileName + " " + wrapperFile
    p.Start()
    p.WaitForExit()
    
    
    msg = p.StandardError.ReadToEnd()
    ghenv.Component.AddRuntimeMessage(gh.Kernel.GH_RuntimeMessageLevel.Error, msg)
    
    print(p.StandardOutput.ReadToEnd())


    ## READ THE OUTPUT FROM THE OPEENSEES_SOLVER
    ## THE ORDER MUST BE THE SAME OF THE OUTPUT LIST IN OpenSeesStaticSolver.py

    outputFile = os.path.join(outputFolder, outputFileName)

    with open(outputFile, 'r') as f:
        lines = f.readlines()
        nodeDisplacementWrapper = eval( lines[0].strip() )
        reactionWrapper = eval( lines[1].strip() )
        elementOutputWrapper = eval( lines[2].strip() )
        elementLoadWrapper = eval( lines[3].strip() )
        eleForceWrapper = eval( lines[4].strip() )


    AlpacaLinearStaticOutput = ([nodeDisplacementWrapper,
                            reactionWrapper,
                            elementOutputWrapper,
                            elementLoadWrapper,
                            eleForceWrapper])

    return AlpacaLinearStaticOutput


checkData = True

if not AlpacaModel:
    checkData = False
    msg = "input 'AlpacaModel' failed to collect data"
    ghenv.Component.AddRuntimeMessage(gh.Kernel.GH_RuntimeMessageLevel.Warning, msg)


if checkData != False:
    AlpacaStaticOutput = InitializeStaticAnalysis(AlpacaModel)
    #maxDisplacement = None
# ---------- end analyze_6 ----------
panel_16 = Panel(python_28.ForceDisplay)  # disabled
panel_17 = Panel(analyze_3.Frequency)  # disabled
merge_3 = Merge(Data1=analyze_4.AlpacaStaticOutput, Data2=analyze_5.AlpacaStaticOutput)  # -> flatten(Result); disabled
merge_4 = Merge(Data1=analyze_4.AlpacaStaticOutput, Data2=analyze_5.AlpacaStaticOutput)  # -> flatten(Result); disabled

# ---- group: Reaction Forces
# Reactions
number_slider_11 = Slider(10, range=0..100)  # disabled
file_path_21 = FilePath("C:\GitHub\Alpaca4d\PythonScript\Post-Processing\reaction\reaction.py")  # disabled
toggle_2 = BooleanToggle(True)  # disabled
read_file_21 = ReadFile(File=file_path_21, PerLineParse=False)  # disabled
toggle_3 = BooleanToggle(True)  # disabled
python_29 = GhPythonScript(
    Code=read_file_21,
    AlpacaStaticOutput=analyze_4.AlpacaStaticOutput,
    ReactionForcesView=toggle_3,
    ReactionMomentsView=toggle_2,
    Scale=number_slider_11)  # -> Out, TagPoints, ReactionForce, ReactionMoment, View; disabled
reactionforce = ReactionForce(python_29.ReactionForce)  # disabled
tagpoints = TagPoints(python_29.TagPoints)  # disabled
reactionmoment = ReactionMoment(python_29.ReactionMoment)  # disabled
explode_tree_8 = ExplodeTree(Data=python_29.View)  # -> Branch0, Branch1, Branch2, Branch3, Branch4, Branch5, Branch6; disabled
colour_swatch_9 = ColourSwatch(SwatchColor=RGB(252, 0, 0))  # disabled
colour_swatch_10 = ColourSwatch(SwatchColor=RGB(0, 55, 255))  # disabled
vector_display_ex_5 = VectorDisplayEx(
    Point=explode_tree_8.Branch0,
    Vector=[explode_tree_8.Branch3, explode_tree_8.Branch2, explode_tree_8.Branch1],
    Colour=colour_swatch_9,
    Width=2)  # disabled
vector_display_ex_6 = VectorDisplayEx(
    Point=explode_tree_8.Branch0,
    Vector=[explode_tree_8.Branch6, explode_tree_8.Branch5, explode_tree_8.Branch4],
    Colour=colour_swatch_10,
    Width=2)  # disabled

# ---- group: Cds Visualisation
# CDS view
number_slider_12 = Slider(0.675, range=0.001..10)  # disabled
file_path_22 = FilePath("C:\GitHub\Alpaca4d\PythonScript\Post-Processing\cdsView\cdsView.py")  # disabled
read_file_22 = ReadFile(File=file_path_22, PerLineParse=False)  # disabled
list_4 = ValueList({"N": 0, "V1": 1, "V2": 2, "M2": 3, "M1": 4, "Mt": 5}, selected="N")  # disabled
python_30 = GhPythonScript(Code=read_file_22, AlpacaStaticOutput=analyze_4.AlpacaStaticOutput, Cds=list_4)  # disabled

# ---- group: Beam Forces
# CDS valor
number_slider_13 = Slider(10, range=0..10)  # disabled
file_path_23 = FilePath("C:\GitHub\Alpaca4d\PythonScript\Post-Processing\beamForces\beamForces.py")  # disabled
# beam Component
read_file_23 = ReadFile(File=file_path_23, PerLineParse=False)  # disabled
python_31 = GhPythonScript(Code=read_file_23, AlpacaStaticOutput=analyze_4.AlpacaStaticOutput)  # -> Out, TagElement, N, V1, V2, Mt, M1, M2; disabled

# ---- group: nD Stress Visualisation
# Stress view & valor
file_path_24 = FilePath("C:\GitHub\Alpaca4d\PythonScript\Post-Processing\brickStress\brickStress.py")  # disabled
read_file_24 = ReadFile(File=file_path_24, PerLineParse=False)  # disabled
list_5 = ValueList({"sigmaX": 0, "sigmaY": 1, "sigmaZ": 2, "tauXY": 3, "tauXZ": 4, "tauYZ": 5}, selected="tauYZ")  # disabled
python_32 = GhPythonScript(Code=read_file_24, AlpacaStaticOutput=analyze_5.AlpacaStaticOutput, StressView=list_5)  # -> Brick, StressValue; disabled
bounds_2 = Bounds(Numbers=flatten(python_32.StressValue))  # disabled
deconstruct_domain_2 = DeconstructDomain(Domain=bounds_2)  # -> Start, End; disabled
ghpython_script_3 = GhPythonScript(min=deconstruct_domain_2.Start, max=deconstruct_domain_2.End, value=python_32.StressValue, nColor=list_2)  # -> out, color, tag, domain, colorValue; inputs value: list, nColor: Int32; disabled
# ---------- ghpython_script_3: Python ----------
import Rhino.Geometry as rg
import ghpythonlib.components as ghcomp
import math as mt
import ghpythonlib.treehelpers as th # per data tree
import Grasshopper
#import System as sy #DV
import sys
import rhinoscriptsyntax as rs

'''
ghFilePath = ghenv.LocalScope.ghdoc.Path
ghFileName = ghenv.LocalScope.ghdoc.Name
folderNameLength = len(ghFilePath)-len(ghFileName)-2 #have to remove '.gh'
ghFolderPath = ghFilePath[0:folderNameLength]

outputPath = ghFolderPath + 'assembleData'
wrapperFile = ghFolderPath + 'assembleData\\openSeesModel.txt'

userObjectFolder = Grasshopper.Folders.DefaultUserObjectFolder
fileName = userObjectFolder + 'Alpaca'
'''
fileName = r'C:\GitHub\Alpaca4d\PythonScript\function'
sys.path.append(fileName)
# importante mettere import 'import Rhino.Geometry as rg' prima di importatre DomeFunc
import DomeFunc as dg 
def gradientJet(value, valueMax, valueMin, nColor):
    if nColor == 0:
        listcolo = [rs.CreateColor( 0, 0, 255 ),
                    rs.CreateColor( 0, 128, 255 ),
                    rs.CreateColor( 0, 255, 255 ),
                    rs.CreateColor( 0, 255, 128 ),
                    rs.CreateColor( 128, 255, 0 ),
                    rs.CreateColor( 255, 255, 0 ),
                    rs.CreateColor( 255, 128, 0 ),
                    rs.CreateColor( 204, 0, 0 )]
    elif nColor == 1:
        listcolo = [ rs.CreateColor( 0, 0, 102 ),
                    rs.CreateColor( 0, 0, 255 ),
                    rs.CreateColor( 0, 64, 255 ),
                    rs.CreateColor( 0, 128, 255 ),
                    rs.CreateColor( 0, 191, 255 ),
                    rs.CreateColor( 0, 255, 255 ),
                    rs.CreateColor( 0, 255, 191 ),
                    rs.CreateColor( 0, 255, 128 ),
                    rs.CreateColor( 0, 255, 64 ),
                    rs.CreateColor( 0, 255, 0 ),
                    rs.CreateColor( 64, 255, 0 ),
                    rs.CreateColor( 128, 255, 0 ),
                    rs.CreateColor( 191, 255, 0 ),
                    rs.CreateColor( 255, 255, 0 ),
                    rs.CreateColor( 255, 191, 0 ),
                    rs.CreateColor( 255, 128, 0 ),
                    rs.CreateColor( 255, 64, 0 ),
                    rs.CreateColor( 255, 0, 0 ),
                    rs.CreateColor( 230, 0, 0 ),
                    rs.CreateColor( 204, 0, 0 )]
    #domain = linspace( valueMin,  valueMax, len( listcolo ) )
    n = len( listcolo )
    domain = dg.linspace( valueMin, valueMax, n)
    
    for i in range(1,n):
        if  domain[i-1] <= value <= domain[i]:
            return listcolo[ i ]
        elif  valueMax <= value <= valueMax + 0.00001 :
            return listcolo[ -1 ]
        elif  valueMin - 0.00000000001 <= value <= valueMin  :
            return listcolo[ 0 ]

def gradientJet2(valueMax, valueMin, nColor ):

    if nColor == 0:
        listcolo = [rs.CreateColor( 0, 0, 255 ),
                    rs.CreateColor( 0, 128, 255 ),
                    rs.CreateColor( 0, 255, 255 ),
                    rs.CreateColor( 0, 255, 128 ),
                    rs.CreateColor( 128, 255, 0 ),
                    rs.CreateColor( 255, 255, 0 ),
                    rs.CreateColor( 255, 128, 0 ),
                    rs.CreateColor( 204, 0, 0 )]
    elif nColor == 1:
        listcolo = [ rs.CreateColor( 0, 0, 102 ),
                    rs.CreateColor( 0, 0, 255 ),
                    rs.CreateColor( 0, 64, 255 ),
                    rs.CreateColor( 0, 128, 255 ),
                    rs.CreateColor( 0, 191, 255 ),
                    rs.CreateColor( 0, 255, 255 ),
                    rs.CreateColor( 0, 255, 191 ),
                    rs.CreateColor( 0, 255, 128 ),
                    rs.CreateColor( 0, 255, 64 ),
                    rs.CreateColor( 0, 255, 0 ),
                    rs.CreateColor( 64, 255, 0 ),
                    rs.CreateColor( 128, 255, 0 ),
                    rs.CreateColor( 191, 255, 0 ),
                    rs.CreateColor( 255, 255, 0 ),
                    rs.CreateColor( 255, 191, 0 ),
                    rs.CreateColor( 255, 128, 0 ),
                    rs.CreateColor( 255, 64, 0 ),
                    rs.CreateColor( 255, 0, 0 ),
                    rs.CreateColor( 230, 0, 0 ),
                    rs.CreateColor( 204, 0, 0 )]

    #domain = linspace( valueMin,  valueMax, len( listcolo ) )
    n = len( listcolo )
    diff = (float(valueMax) - valueMin)/( n - 1 )
    domain = [diff * i + valueMin  for i in range(n)]
    return [ listcolo, domain ]

colorList = gradientJet2( max, min, nColor )
color = colorList[0]  #.reverse()
color.reverse()
tag = []
tag.append( str(round(colorList[1][0],2) ) )
for i in range(1,len(colorList[1])):
    tag.append( str(round(colorList[1][i-1],2)) + '< valor < ' + str(round(colorList[1][i],2)) )
domain = colorList[1]
tag.reverse()

colorValue = []
for i in value:
    colorValue.append(gradientJet(i, max, min, nColor))
    print(len(value))
# ---------- end ghpython_script_3 ----------
panel_18 = Panel("{0}")  # disabled
panel_19 = Panel("{0}")  # disabled
panel_20 = Panel("{0}")  # disabled
split_tree = SplitTree(Data=simplify(ghpython_script_3.color), Masks=simplify(panel_18))  # -> Positive, Negative; disabled
split_tree_2 = SplitTree(Data=simplify(ghpython_script_3.tag), Masks=simplify(panel_19))  # -> Positive, Negative; disabled
mesh_colours = MeshColours(Mesh=graft(python_32.Brick), Colours=ghpython_script_3.colorValue)  # disabled
split_tree_3 = SplitTree(Data=simplify(ghpython_script_3.domain), Masks=simplify(panel_20))  # -> Positive, Negative; disabled

# ---- group: shell Force Visualisation
# Forces view
# da riguardare per i valori
file_path_25 = FilePath("C:\GitHub\Alpaca4d\PythonScript\Post-Processing\shellForceView\shellForceView.py")  # disabled
read_file_25 = ReadFile(File=file_path_25, PerLineParse=False)  # disabled
list_6 = ValueList({"8Color": 0, "20Color": 1}, selected="8Color")
list_7 = ValueList({"Fx": 0, "Fy": 1, "Fz": 2, "Mx": 3, "My": 4, "Mz": 5}, selected="Fx")  # disabled
python_33 = GhPythonScript(Code=read_file_25, AlpacaStaticOutput=analyze_4.AlpacaStaticOutput, ViewForce=list_7)  # -> ModelForce, ForceValue; disabled
bounds_3 = Bounds(Numbers=flatten(python_33.ForceValue))  # disabled
file_path_26 = FilePath("C:\GitHub\Alpaca4d\PythonScript\function\AlpacaColorMesh.py")  # disabled
deconstruct_domain_3 = DeconstructDomain(Domain=bounds_3)  # -> Start, End; disabled
read_file_26 = ReadFile(File=file_path_26, PerLineParse=False)  # disabled
ghpython_script_4 = GhPythonScript(
    Code=read_file_26,
    Min=deconstruct_domain_3.Start,
    Max=deconstruct_domain_3.End,
    Value=python_33.ForceValue,
    NColor=list_6)  # -> Out, Color, Tag, Domain, ColorValue; disabled
panel_21 = Panel("{0}")  # disabled
panel_22 = Panel("{0}")  # disabled
panel_23 = Panel("{0}")  # disabled
split_tree_4 = SplitTree(Data=simplify(ghpython_script_4.Color), Masks=simplify(panel_21))  # -> Positive, Negative; disabled
split_tree_5 = SplitTree(Data=simplify(ghpython_script_4.Tag), Masks=simplify(panel_22))  # -> Positive, Negative; disabled
split_tree_6 = SplitTree(Data=simplify(ghpython_script_4.Domain), Masks=simplify(panel_23))  # -> Positive, Negative; disabled
mesh_colours_2 = MeshColours(Mesh=graft(python_33.ModelForce), Colours=ghpython_script_4.ColorValue)  # disabled
positive = Positive(split_tree_5.Positive)  # disabled
mesh_5 = Mesh(mesh_colours_2)  # disabled
positive_2 = Positive(split_tree_4.Positive)  # disabled

# ---- group: shell Forces
# Forces valor
file_path_27 = FilePath("C:\GitHub\Alpaca4d\PythonScript\Post-Processing\shellForces\shellForces.py")  # disabled
read_file_27 = ReadFile(File=file_path_27, PerLineParse=False)  # disabled
python_34 = GhPythonScript(Code=read_file_27, AlpacaStaticOutput=analyze_4.AlpacaStaticOutput)  # -> Out, TagElement, Fx, Fy, Fz, Mx, My, Mz; disabled

# ----
# displacement Component
# deformedModelView
# OK!
number_slider_14 = Slider(1172, range=0..10000)  # disabled
file_path_28 = FilePath("C:\GitHub\Alpaca4d\PythonScript\Post-Processing\defModelView\defModelView.py")  # disabled
read_file_28 = ReadFile(File=file_path_28, PerLineParse=False)  # disabled
toggle_4 = BooleanToggle(False)  # disabled
list_8 = ValueList({"tx": 0, "ty": 1, "tz": 2}, selected="tz")  # disabled
python_35 = GhPythonScript(Code=read_file_28, AlpacaStaticOutput=merge_3, Direction=list_8, Scale=number_slider_14, ModelExstrud=toggle_4)  # -> Out, ModelDisp, ModelCurve, Max_min; disabled
modeldisp = ModelDisp(python_35.ModelDisp)  # disabled
max_min = Max_min(python_35.Max_min)  # disabled
explode_tree_9 = ExplodeTree(Data=python_35.ModelCurve)  # -> Branch0, Branch1, Branch2; disabled
divide_curve = DivideCurve(Curve=explode_tree_9.Branch0, Count=explode_tree_9.Branch1, Kinks=False)  # -> Points, Tangents, simplify(Parameters); disabled
shatter = Shatter(Curve=graft(explode_tree_9.Branch0), Parameters=divide_curve.Parameters)  # -> simplify(Segments); disabled
number_slider_15 = Slider(2, range=0..10)  # disabled
curve_direction_2 = GhPythonScript(Crv=flatten(shatter), Thickness=number_slider_15, RGB=explode_tree_9.Branch2)  # -> out; inputs Crv: list of Curve, RGB: list of Color; disabled; same code as curve_direction

# ---- group: brick Displacement
python_36 = GhPythonScript(Code=read_file_14, AlpacaStaticOutput=analyze_5.AlpacaStaticOutput)  # -> Out, TagElement, Trans; disabled

# ---- group: Shell Displacement
python_37 = GhPythonScript(Code=read_file_12, AlpacaStaticOutput=analyze_4.AlpacaStaticOutput)  # -> Out, TagElement, Trans, Rot; disabled

# ---- group: Beam Displacement
python_38 = GhPythonScript(Code=read_file_11, AlpacaStaticOutput=analyze_4.AlpacaStaticOutput, NumberResults=number_slider_6)  # -> Out, TagElement, LocalTrans, LocalRot, GlobalTrans, GlobalRot; disabled

# ---- group: NodeDisp
python_39 = GhPythonScript(Code=read_file_13, AlpacaStaticOutput=merge_4)  # -> Out, Points, Trans, Rot; disabled

# ----
# Force component
panel_24 = Panel(python_34.Fx)  # disabled

# ----
# OK!
file_path_29 = FilePath("C:\GitHub\Alpaca4d\PythonScript\Post-Processing\disassembleModel\disassembleModel.py")  # disabled
read_file_29 = ReadFile(File=file_path_29, PerLineParse=False)  # disabled

# ---- group: disassemble Model
python_40 = GhPythonScript(Code=read_file_29, AlpacaModel=python_27.AlpacaModel)  # -> ModelView, ModelViewExtruded, Points, Support, Load, Material, Section; disabled

# ----
panel_25 = Panel(python_40.ModelViewExtruded)  # disabled

# ----
# EarthQuake Analyses
path_6 = FilePath("C:\GitHub\Alpaca4d\PythonScript\Analyses\EarthQuakeAnalysis\BM68elc.acc")  # disabled
panel_26 = Panel("1")  # disabled
path_7 = FilePath("C:\GitHub\Alpaca4d\PythonScript\Analyses\EarthQuakeAnalysis\initializeEarthQuakeAnalysis.py")  # disabled
panel_27 = Panel("0.01")  # disabled
list_9 = ValueList({"x": 1, "y": 2, "z": 3}, selected="y")  # disabled
panel_28 = Panel("1")  # disabled
file_6 = ReadFile(File=path_7, PerLineParse=False)  # disabled

file_7 = ReadFile(File=path_6, PerLineParse=False)  # disabled
panel_29 = Panel(" ")  # disabled
split = TextSplit(Text=file_7, Separators=panel_29)  # disabled
panel_30 = Panel("1")  # disabled
division = Division(A=split, B=panel_30)  # disabled
clean_3 = CleanTree(RemoveNulls=True, RemoveInvalid=True, RemoveEmpty=invert(False), Tree=division)  # disabled
graph = QuickGraph(clean_3, SortOrder=0)  # disabled
lng = ListLength(List=clean_3)  # disabled
multiplication_3 = Multiplication(A=lng, B=panel_27)  # disabled
earthquake_file_seconds = Panel(multiplication_3)  # disabled

series_5 = Series(Start=0, Step=panel_27, Count=lng)  # disabled

analyze_7 = GhPythonScript(
    Code=file_6,
    AlpacaModel=data_19,
    TmaxAnalyses=panel_28,
    GroundMotionDirection=list_9,
    GroundMotionValues=clean_3,
    GroundMotionTimeStep=series_5,
    GroundMotionFactor=panel_26,
    TimeStepIncrement=panel_9,
    Damping=0.02,
    NewmarkGamma=0.5,
    NewmarkBeta=0.25)  # -> Out, AlpacaGroundmotionOutput, MaxDisplacement, MinDisplacement; disabled

panel_31 = Panel(analyze_7.MinDisplacement)  # disabled
panel_32 = Panel(analyze_7.MaxDisplacement)  # disabled

number_of_line_to_skip = Slider(1, range=1..100)  # disabled
number_slider_16 = Slider(750, range=0..1000)  # disabled
toggle_5 = BooleanToggle(True)  # disabled
button = Button()  # disabled
toggle_6 = BooleanToggle(False)  # disabled
list_10 = ValueList({"tx": 0, "ty": 1, "tz": 2}, selected="ty")  # disabled
ghpython_script_5 = GhPythonScript(
    Code=file_3,
    OpenSeesOutputWrapper=analyze_7.AlpacaGroundmotionOutput,
    Speed=panel_11,
    Animate=toggle_6,
    Reset=button,
    Scale=number_slider_16,
    Direction=list_10,
    ModelExstrud=toggle_5)  # -> Out, ModelDisp, ModelCurve, Trans, Rot; disabled
modeldisp_2 = ModelDisp(ghpython_script_5.ModelDisp)  # disabled
explode_tree_10 = ExplodeTree(Data=ghpython_script_5.ModelCurve)  # -> Branch0, Branch1, Branch2; disabled
divide_curve_2 = DivideCurve(Curve=explode_tree_10.Branch0, Count=explode_tree_10.Branch1, Kinks=False)  # -> Points, Tangents, simplify(Parameters); disabled
number_slider_17 = Slider(3, range=0..10)  # disabled
shatter_2 = Shatter(Curve=graft(explode_tree_10.Branch0), Parameters=divide_curve_2.Parameters)  # -> simplify(Segments); disabled
curve_direction_3 = GhPythonScript(Crv=flatten(shatter_2), Thickness=number_slider_17, RGB=explode_tree_10.Branch2)  # -> out; inputs Crv: list of Curve, RGB: list of Color; disabled; same code as curve_direction

devec = DeconstructVector(Vector=ghpython_script_5.Trans)  # -> XComponent, YComponent, ZComponent; disabled
graph_2 = QuickGraph([devec.XComponent, devec.YComponent, devec.ZComponent], SortOrder=0)  # disabled

# ----
# Modal Animate
number_slider_18 = Slider(7, range=0..10)  # disabled
number_slider_19 = Slider(1, range=1..50)  # disabled
number_slider_20 = Slider(2, range=0..10)  # disabled
button_2 = Button()  # disabled
toggle_7 = BooleanToggle(False)  # disabled
toggle_8 = BooleanToggle(False)  # disabled
path_8 = FilePath("C:\GitHub\Alpaca4d\PythonScript\Post-Processing\animateModal\animateModal.py")  # disabled
list_11 = ValueList({"tx": 0, "ty": 1, "tz": 2}, selected="ty")  # disabled
file_8 = ReadFile(File=path_8, PerLineParse=False)  # disabled
max_min_2 = Max_min()  # disabled
number_slider_21 = Slider(3, range=0..10)  # disabled

# ---- group: MODAL ANALYSIS
ghpython_script_6 = GhPythonScript(
    Code=file_8,
    OpenSeesOutputWrapper=analyze_3.AlpacaModalOutput,
    NumberMode=number_slider_20,
    Speed=number_slider_19,
    Animate=toggle_8,
    Reset=button_2,
    Scale=number_slider_18,
    Direction=list_11,
    ModelExstrud=toggle_7)  # -> Out, ModelDisp, ModelCurve; disabled

# ----
modeldisp_3 = ModelDisp(ghpython_script_6.ModelDisp)  # disabled
explode_tree_11 = ExplodeTree(Data=ghpython_script_6.ModelCurve)  # -> Branch0, Branch1, Branch2; disabled
divide_curve_3 = DivideCurve(Curve=explode_tree_11.Branch0, Count=explode_tree_11.Branch1, Kinks=False)  # -> Points, Tangents, simplify(Parameters); disabled
shatter_3 = Shatter(Curve=graft(explode_tree_11.Branch0), Parameters=divide_curve_3.Parameters)  # -> simplify(Segments); disabled
curve_direction_4 = GhPythonScript(Crv=flatten(shatter_3), Thickness=number_slider_21, RGB=explode_tree_11.Branch2)  # -> out; inputs Crv: list of Curve, RGB: list of Color; disabled; same code as curve_direction

# ---- group: Shell Stress Visualisation
# Stress view & valor
file_path_30 = FilePath("C:\GitHub\Alpaca4d\PythonScript\Post-Processing\shellStressView\shellStressView.py")
read_file_30 = ReadFile(File=file_path_30, PerLineParse=False)
list_12 = ValueList({"pxx": 0, "pyy": 1, "pxy": 2, "txz": 3, "tyz": 4, "mxx": 5, "myy": 6, "mxy": 7}, selected="pxx")
python_41 = GhPythonScript(Code=read_file_30, AlpacaStaticOutput=analyze_4.AlpacaStaticOutput, StressView=list_12)  # -> Shell, StressValue
bounds_4 = Bounds(Numbers=flatten(python_41.StressValue))  # disabled
deconstruct_domain_4 = DeconstructDomain(Domain=bounds_4)  # -> Start, End; disabled
panel_33 = Panel("{0}")  # disabled
panel_34 = Panel("{0}")  # disabled
panel_35 = Panel("{0}")  # disabled

# ----
# shell Component
list_13 = ValueList({"8Color": 0, "20Color": 1}, selected="8Color")
stressvalue = StressValue(python_41.StressValue)  # disabled
file_path_31 = FilePath("C:\GitHub\Alpaca4d\PythonScript\function\AlpacaColorMesh.py")  # disabled
read_file_31 = ReadFile(File=file_path_31, PerLineParse=False)  # disabled

# ---- group: Shell Stress Visualisation (continued)
ghpython_script_7 = GhPythonScript(
    Code=read_file_31,
    Min=deconstruct_domain_4.Start,
    Max=deconstruct_domain_4.End,
    Value=python_41.StressValue,
    NColor=list_13)  # -> Out, Color, Tag, Domain, ColorValue; disabled
split_tree_7 = SplitTree(Data=simplify(ghpython_script_7.Color), Masks=simplify(panel_33))  # -> Positive, Negative; disabled
split_tree_8 = SplitTree(Data=simplify(ghpython_script_7.Tag), Masks=simplify(panel_34))  # -> Positive, Negative; disabled
split_tree_9 = SplitTree(Data=simplify(ghpython_script_7.Domain), Masks=simplify(panel_35))  # -> Positive, Negative; disabled
mesh_colours_3 = MeshColours(Mesh=graft(python_41.Shell), Colours=ghpython_script_7.ColorValue)  # disabled
positive_3 = Positive(split_tree_8.Positive)  # disabled
positive_4 = Positive(split_tree_7.Positive)  # disabled
mesh_6 = Mesh(mesh_colours_3)  # disabled
